# Grasshopper definition dev_spiral.ghx (Grasshopper 1.0.7)

pt = ConstructPoint(XCoordinate="600", YCoordinate="600", ZCoordinate="0")
pt_2 = Point(pt)
vec = VectorXYZ(XComponent="500", YComponent="500", ZComponent="500")  # -> Vector, Length
cyl = Cylinder(Base=pt_2, Radius="300", Length="800")
area = Area(Geometry=cyl)  # -> Area, Centroid
box = CenterBox(Base=area.Centroid, X="500", Y="150", Z="150")
move = Move(Geometry=pt_2, Motion=vec.Vector)  # -> Geometry, Transform
cap = CapHoles(Brep=cyl)
merge = Merge(Data1=cap, Data2=box)
box_2 = Box2Pt(PointA=pt_2, PointB=move.Geometry, Plane=PlaneXY(0, 0, 0))
sint = SolidIntersection(BrepsA=box_2, BrepsB=cap)
sunion = SolidUnion(Breps=merge)
smooth = SettingsQuality()
mesh = MeshBrep(Brep=sunion, Settings=smooth)
tri = Triangulate(Mesh=mesh)  # -> Mesh, Count
panel = Panel("C:\Users\ysoky\Documents\Digital_Artisan\Spiral_Slice_Geometry")
# Dev - Spiral Slice Geometry
panel_2 = Panel("C:\Users\yoshioca\Documents\Digital_Artisan_win\Spiral_Slice_Geometry")
medges = MeshEdges(Mesh=tri.Mesh)  # -> NakedEdges, InteriorEdges, NonManifoldEdges

# ---- group: Add Module Path
python = GhPythonScript(PATH_DESKTOP=panel, PATH_LAPTOP=panel_2, BOOL=Toggle(False))  # -> out, a
# ---------- python: Python ----------
import sys

if BOOL:
    sys.path.append(PATH_DESKTOP)
    sys.path.append(PATH_LAPTOP)

print(sys.path)
# ---------- end python ----------

# ----
python_2 = GhPythonScript(MESH=tri.Mesh, LAYER_HEIGHT=Slider(5, range=1..10), WALL_THICKNESS=Slider(10, range=0..10), SLICE=Toggle(False))  # -> out, dev, OFFSET_CURVE, a, b, c, d, e
# ---------- python_2: Python ----------
import math

import rhinoscriptsyntax as rs
import Rhino.Geometry as rg

import ghpythonlib.components as ghcp



from spiral_slice_geometry import slicing
reload(slicing)


ss = slicing.Slicing()

MACHINE_MAX_Z = 1000


target_mesh = rs.coercemesh(MESH)
layer_height = LAYER_HEIGHT
offset_value = WALL_THICKNESS


if SLICE:
    
    inter_pl = ss.slice_mesh(target_mesh, layer_height)
    off_pl = ss.offset_curves(inter_pl, offset_value)
    
    OFFSET_CURVE = off_pl
# ---------- end python_2 ----------
panel_3 = Panel(python.out)
crv = Curve(python_2.OFFSET_CURVE)
end = EndPoints()  # -> Start, End
end_2 = EndPoints(Curve=crv)  # -> Start, End
panel_4 = Panel(python_2.b)
